# Grasshopper definition PhD-3_ParcelAssembly.gh (Grasshopper 1.0.7)
# plug-ins: EleFront, Sasquatch, Impala, LunchBoxML, Kangaroo2 Components, Human

reflay = ReferenceByLayer(LayerName="Transit::Feasible Parcels")
border = SurfaceBorder(Surface=reflay)  # -> OuterBorder, InnterBorder
deatt = DeconstructAttributes(ReferencedGeometryOrAttributes=reflay)  # -> Keys, Values
tmatch = MatchText(Text=deatt.Keys, Pattern="Type", Case=True)
cull = CullPattern(List=deatt.Values, CullPattern=tmatch)
dispatch = Dispatch(List=graft(border.OuterBorder), DispatchPattern=cull)  # -> ListA, ListB
data = Data(flatten(dispatch.ListA))
data_2 = Data(simplify(dispatch.ListB))
area = Area(Geometry=data)  # -> Area, Centroid; disabled
area_2 = Area(Geometry=data_2)  # -> Area, flatten(Centroid)
con = DelaunayEdges(Points=area.Centroid, Plane=PlaneXY(0, 0, 0))  # -> Connectivity, Edges
graft = GraftTree(Tree=area.Centroid, IncludeEmptyLists=True, IncludeNullItems=True)
item = ListItem(List=area.Centroid, Index=con.Connectivity, Wrap=True)  # -> simplify(Item)
rtree = CreateRTree(InputGeometry=area_2.Centroid)
graft_2 = GraftTree(Tree=area_2.Centroid, IncludeEmptyLists=True, IncludeNullItems=True)
rtree_range = RTreePointsInRange(SearchPoints=area_2.Centroid, SearchDistance=Slider(50, range=0..100), RTree=rtree)  # -> simplify(PointsWithinRange), IndicesWithinRange
dist = Distance(PointA=graft, PointB=item)
panel = Panel(dist)
panel_2 = Panel("2")
smaller = SmallerThan(FirstNumber=dist, SecondNumber=0)  # -> SmallerThan, OrEqualTo
cps = ClosestPoints(Point=graft_2, Cloud=rtree_range.PointsWithinRange, Count=3)  # -> ClosestPoint, CPIndex, Distance
panel_3 = Panel(cps.Distance)
item_2 = ListItem(List=cps.ClosestPoint, Index=1, Wrap=True)
ln = Line(StartPoint=graft_2, EndPoint=item_2)  # -> flatten(Line)
parcccp = ParClosestCurveCP(Threshold=1.797693135e+308)  # -> Points, Parameters, Index, Distance; disabled
clean = CleanTree(RemoveNulls=True, RemoveInvalid=True, RemoveEmpty=False, Tree=ln)
flatten = FlattenTree(Tree=data_2, Path="{0}")
dupln = RemoveDuplicateLines(Lines=clean, Tolerance=0.01)
join = JoinCurves(Curves=dupln, Preserve=False)
curvepoint = PointOnCurve(join, parameter=0.5)
rtree_range_2 = RTreePointsInRange(SearchPoints=curvepoint, SearchDistance=Slider(100, range=0..100), RTree=rtree)  # -> simplify(PointsWithinRange), IndicesWithinRange
graft_3 = GraftTree(Tree=join, IncludeEmptyLists=True, IncludeNullItems=True)  # -> simplify(Tree)
item_3 = ListItem(List=flatten, Index=rtree_range_2.IndicesWithinRange, Wrap=True)  # -> simplify(Item)
parccx = ParCurveCurveIntersect(CurveA=item_3, CurveB=graft_3)  # -> Points, ParamsA, ParamsB, Intersection
pshift = ShiftPaths(Data=parccx.Intersection, Offset=-1)
cull_2 = CullPattern(List=item_3, CullPattern=pshift)
runion = RegionUnion(Curves=cull_2)
previewlw = CustomPreviewLineweights(Geometry=runion, Shader=ColourSwatch(SwatchColor=RGB(255, 162, 0)), Thickness=Slider(6, range=0..10), Absolute=False)
