# Grasshopper definition PhD-2_ResidualLandValue.gh (Grasshopper 1.0.7)
# plug-ins: Telepathy, EleFront, Human, LunchBoxML, LunchBox

python = GhPythonScript()  # -> out, a
# ---------- python: Python ----------
__author__ = "nicholasmartino"

import os
import rhinoscriptsyntax as rs

os.environ["APPDATA"] = "/Users/nicholasmartino/Library/Application Support"
a = True
# ---------- end python ----------
pt = ConstructPoint(XCoordinate=0, YCoordinate=0, ZCoordinate=0)
filter = StreamFilter(Gate=python.a, Stream1=Toggle(True))
filter_2 = StreamFilter(Gate=python.a, Stream1=pt)
shrimp_location = ShrimpGISLocation(latitude="49.24966", longitude="-123.11934", anchor_point=filter_2)  # -> location; inputs anchor_point: Point3d; plug-in component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
path = FilePath("/Volumes/GoogleDrive/My Drive/Python/morphology/PhD/data/geojson/parcels4326_Vancouver.geojson")
shrimp_read_geojson = ShrimpGISReadGeojson(geojson_file=path, location=shrimp_location, run_it=filter)  # -> read_me, field, type, flatten(geometry); inputs run_it: Boolean; plug-in component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
shrimplocation = RemoteSender(shrimp_location)
cluster = Cluster(field=shrimp_read_geojson.field, name="land_value_sqm")
field = RemoteSender(shrimp_read_geojson.field)
area = Area(Geometry=shrimp_read_geojson.geometry)  # -> Area, Centroid
multiplication = Multiplication(A=cluster, B=area.Area)
smaller = SmallerThan(FirstNumber=area.Area, SecondNumber=Slider(10000, range=0..10000))  # -> SmallerThan, OrEqualTo
larger = LargerThan(FirstNumber=area.Area, SecondNumber=Slider(150, range=0..1000))  # -> LargerThan, OrEqualTo
and = GateAnd(A=larger.LargerThan, B=smaller.SmallerThan)
cull = CullPattern(List=cluster, CullPattern=and)
cull_2 = CullPattern(List=shrimp_read_geojson.geometry, CullPattern=and)
cull_3 = CullPattern(List=multiplication, CullPattern=and)
landvaluesqm = RemoteSender(cull)
shrimp_dec_field = ShrimpGISDecomposeField(field=shrimp_read_geojson.field)  # -> read_me, name, values; inputs field: list; plug-in component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
cull_4 = CullPattern(List=area.Centroid, CullPattern=and)
geometry = RemoteSender(cull_2)
landvalue = RemoteSender(cull_3)
cull_5 = CullPattern(List=area.Area, CullPattern=and)
centroids = RemoteSender(cull_4)
fieldnames = RemoteSender(shrimp_dec_field.name)
cull_6 = CullPattern(List=shrimp_dec_field.values, CullPattern=and)
geometryarea = RemoteSender(cull_5)
fieldvalues = RemoteSender(cull_6)

panel = Panel("""Townhouse
Multi-Family""")
type = RemoteSender(panel)
list = ValueList({"Baseline", "Transit", "Arterial"}, selected="Arterial")
panel_2 = Panel("""9
90""")
panel_3 = Panel("""2000
3400""")
panel_4 = Panel("""11000
10000""")
dom = ConstructDomain(DomainStart=Slider(0.5, range=0.5..1), DomainEnd=Slider(4, range=0..10))
path_2 = FilePath("/Users/nicholasmartino/Projects/affordable-walkability/")
densitycores = RemoteSender(list)
densitycores_2 = RemoteReceiver(densitycores)
case = TextCase(Text=densitycores_2, Culture=127)  # -> UpperCase, LowerCase
basedirectory = RemoteSender(path_2)
maxheights = RemoteSender(panel_2)
costs = RemoteSender(panel_3)
sellprice = RemoteSender(panel_4)
fsrdomain = RemoteSender(dom)
fsrdomain_2 = RemoteReceiver(fsrdomain)
radius = RemoteSender(Slider(800, range=0..10000))
radius_2 = RemoteReceiver(radius)
concat = Concatenate(
    FragmentG=case.UpperCase,
    FragmentF=" - ",
    FragmentA=fsrdomain_2,
    FragmentB=" MaxFSR",
    FragmentE=" - ",
    FragmentC=radius_2,
    FragmentD=" Radius")
paramstr = RemoteSender(concat)

geometry_2 = RemoteReceiver(geometry)
sellprice_2 = RemoteReceiver(simplify(graft(sellprice)))
pt_2 = Point(Point(94.44893506, 3650.060101, 0))
area_2 = Area(Geometry=geometry_2)  # -> Area, Centroid
expression = Expression(x=sellprice_2, Expression="x * 1.15")
expression_2 = Expression(x=sellprice_2, Expression="x * 0.85")
dist = Distance(PointA=area_2.Centroid, PointB=pt_2)
bnd = Bounds(Numbers=dist)
dom_2 = ConstructDomain(DomainStart=expression, DomainEnd=expression_2)
remap = RemapNumbers(Value=dist, Source=bnd, Target=dom_2)  # -> Mapped, Clipped
adjsellprice = RemoteSender(remap.Mapped)

# ---- group: Baseline
densitycores_3 = RemoteReceiver(densitycores)
geometry_3 = RemoteReceiver(geometry)
concat_2 = Concatenate(FragmentA=densitycores_3, FragmentB="::Density Cores")
reflay = ReferenceByLayer(LayerName=concat_2, DisableAutoUpdate=False)
fsrdomain_3 = RemoteReceiver(fsrdomain)
radius_3 = RemoteReceiver(radius)
densitycorepts = RemoteSender(reflay)
cluster_2 = Cluster_3(points=reflay, radius=radius_3, surfaces=geometry_3, domain=fsrdomain_3)  # -> fsr, minfsr, maxfsr
adjsellprice_2 = RemoteReceiver(adjsellprice)
maxheights_2 = RemoteReceiver(maxheights)
landvalue_2 = RemoteReceiver(landvalue)
costs_2 = RemoteReceiver(costs)
maxfsr = RemoteSender(cluster_2.fsr)
geometry_4 = RemoteReceiver(geometry)
cluster_3 = Cluster_2(
    parcels=geometry_4,
    maxfsr=cluster_2.fsr,
    maxheight=maxheights_2,
    hardcosts=costs_2,
    sellprice=adjsellprice_2,
    landvalue=landvalue_2)  # -> graft(pfsr), graft(ba), graft(lrv), simplify(feasible), simplify(type_2), simplify(maxresidual_2), keys, values
expression_3 = Expression(x=cluster_3.type_2, Expression="x=0")
tstat = TreeStatistics(Tree=cluster_3.values)  # -> Paths, Length, Count
expression_4 = Expression(x=cluster_3.type_2, Expression="x=1")
densitycores_4 = RemoteReceiver(densitycores)
geometry_5 = RemoteReceiver(geometry)
and_2 = GateAnd(A=cluster_3.feasible, B=expression_3)
and_3 = GateAnd(A=cluster_3.feasible, B=expression_4)
cull_7 = CullPattern(List=tstat.Paths, CullPattern=cluster_3.feasible)
panel_5 = Panel("""Land Value
Max FSR
Practical FSR
Buildable Area
Residual Land Value
Feasible
Type""")
branch = TreeBranch(Tree=cluster_3.values, Path=cull_7, MaintainPaths=True)
concat_3 = Concatenate(FragmentA=densitycores_4, FragmentB="::Feasible Parcels")
cull_8 = CullPattern(List=geometry_5, CullPattern=and_2)
geometry_6 = RemoteReceiver(geometry)
geometry_7 = RemoteReceiver(geometry)
area_3 = Area(Geometry=cull_8)  # -> Area, Centroid
attributes = DefineObjectAttributes(UserKeys=panel_5, UserValues=branch, Name=concat_3, Layer=concat_3)
branch_2 = TreeBranch(Tree=simplify(graft(geometry_6)), Path=cull_7, MaintainPaths=True)
cull_9 = CullPattern(List=geometry_7, CullPattern=and_3)
circle = CircleCNR(Center=area_3.Centroid, Normal=Vector(0, 0, 1), Radius=Slider(2, range=0..10))
area_4 = Area(Geometry=cull_9)  # -> Area, Centroid
previewlw = CustomPreviewLineweights(Geometry=circle, Shader=ColourSwatch(SwatchColor=RGB(79, 79, 79)), Absolute=False)
bake = BakeObjects(Geometry=branch_2, Attributes=attributes, BakeName=concat_3, Bake=Toggle(True))
circle_2 = CircleCNR(Center=area_4.Centroid, Normal=Vector(0, 0, 1), Radius=Slider(3, range=0..10))
previewlw_2 = CustomPreviewLineweights(Geometry=circle_2, Shader=ColourSwatch(SwatchColor=RGB(0, 0, 0)), Absolute=False)

# ---- group: Density Cores (GIS to GH)
pt_3 = ConstructPoint(XCoordinate=0, YCoordinate=0, ZCoordinate=0)  # disabled
panel_6 = Panel("-123.11934")  # disabled
panel_7 = Panel("49.24966")  # disabled
shrimp_location_2 = ShrimpGISLocation(latitude=panel_7, longitude=panel_6, anchor_point=pt_3)  # -> location; inputs anchor_point: Point3d; disabled; plug-in component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
toggle = BooleanToggle(True)  # disabled
path_3 = FilePath("G:\My Drive\Python\morphology\PhD\data\density_cores.geojson")  # disabled
shrimp_read_geojson_2 = ShrimpGISReadGeojson(geojson_file=path_3, location=shrimp_location_2, run_it=toggle)  # -> read_me, field, type, flatten(geometry); inputs run_it: Boolean; disabled; plug-in component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
shrimp_dec_field_2 = ShrimpGISDecomposeField(field=shrimp_read_geojson_2.field)  # -> read_me, name, values; inputs field: list; disabled; plug-in component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
panel_8 = Panel("type")  # disabled
index = ItemIndex(List=shrimp_dec_field_2.name, Item=shrimp_dec_field_2.name)  # disabled
keysearch = KeyValueSearch(Keys=shrimp_dec_field_2.name, Values=index, Search=panel_8)  # disabled
branch_3 = TreeBranch(Tree=shrimp_dec_field_2.values, Path=keysearch, MaintainPaths=True)  # disabled
cset = CreateSet(List=branch_3)  # -> Set, Map; disabled
index_2 = ItemIndex(List=branch_3, Item=branch_3)  # disabled
number_slider = Slider(0, range=0..3)  # disabled
c_script = CSharpScript(Attributes=branch_3, Geometry=shrimp_read_geojson_2.geometry)  # -> out, A, B; inputs Attributes: list of String, Geometry: list; disabled
# ---------- c_script: C# ----------
    DataTree<object> outTree = new DataTree<object>();
    List<string> outList = new List<string>();

    // Get unique objects in the Attributes list
    var h = new HashSet<string>(Attributes.ToArray());
    List<string> unique = new List<string>();
    foreach (var val in h)
    {
      unique.Add(val);
    }

    // Iterate over unique attributes and append geometry to data tree
    for (int i = 0; i < unique.Count; i++)
    {
      outList.Add(unique[i]);
      for (int j = 0; j < Geometry.Count; j++)
      {
        if (unique[i] == Attributes[j])
        {
          GH_Path path = new GH_Path(i);
          outTree.Add(Geometry[j], path);
        }
      }
    }

    // Outputs
    A = outTree;
    B = outList;
# ---------- end c_script ----------
keysearch_2 = KeyValueSearch(Keys=branch_3, Values=index_2, Search=cset.Set)  # disabled
number_slider_2 = Slider(1, range=0..3)  # disabled
number_slider_3 = Slider(2, range=0..3)  # disabled
panel_9 = Panel(keysearch_2)  # disabled
branch_4 = TreeBranch(Tree=c_script.A, Path=number_slider, MaintainPaths=True)  # disabled
item = ListItem(List=c_script.B, Index=number_slider, Wrap=True)  # disabled
branch_5 = TreeBranch(Tree=c_script.A, Path=number_slider_2, MaintainPaths=True)  # disabled
branch_6 = TreeBranch(Tree=c_script.A, Path=number_slider_3, MaintainPaths=True)  # disabled
panel_10 = Panel(c_script.A)  # disabled
item_2 = ListItem(List=c_script.B, Index=number_slider_2, Wrap=True)  # disabled
attributes_2 = DefineObjectAttributes(Name=item, Layer=item)  # disabled
item_3 = ListItem(List=c_script.B, Index=number_slider_3, Wrap=True)  # disabled
attributes_3 = DefineObjectAttributes(Name=item_2, Layer=item_2)  # disabled
attributes_4 = DefineObjectAttributes(Name=item_3, Layer=item_3)  # disabled
bake_2 = BakeObjects(Geometry=branch_4, Attributes=attributes_2, BakeName=item, Bake=invert(False))  # disabled
bake_3 = BakeObjects(Geometry=branch_6, Attributes=attributes_4, BakeName=item_3, Bake=invert(False))  # disabled
bake_4 = BakeObjects(Geometry=branch_5, Attributes=attributes_3, BakeName=item_2, Bake=invert(False))  # disabled

# ----
landvalue_3 = RemoteReceiver(landvalue)
basedirectory_2 = RemoteReceiver(basedirectory)
larger_2 = LargerThan(FirstNumber=landvalue_3, SecondNumber=0)  # -> LargerThan, OrEqualTo
paramstr_2 = RemoteReceiver(paramstr)
geometry_8 = RemoteReceiver(geometry)
cull_10 = CullPattern(List=cluster_3.maxresidual_2, CullPattern=larger_2.LargerThan)
cull_11 = CullPattern(List=landvalue_3, CullPattern=larger_2.LargerThan)
concat_4 = Concatenate(FragmentD=basedirectory_2, FragmentA="png/", FragmentB=paramstr_2)
division = Division(A=cull_10, B=cull_11)
basefilename = RemoteSender(concat_4)
cull_12 = CullPattern(List=geometry_8, CullPattern=larger_2.LargerThan)
basefilename_2 = RemoteReceiver(basefilename)
basefilename_3 = RemoteReceiver(basefilename)
densitycorepts_2 = RemoteReceiver(densitycorepts)
radius_4 = RemoteReceiver(radius)
concat_5 = Concatenate(FragmentA=basefilename_2, FragmentB=" - Feasibility (RLVLV).png")
concat_6 = Concatenate(FragmentA=basefilename_3, FragmentB=" - Max FSR.png")
densitycorepts_3 = RemoteReceiver(densitycorepts)
radius_5 = RemoteReceiver(radius)
geometry_9 = RemoteReceiver(geometry)
cluster_4 = Cluster_4(
    points=densitycorepts_2,
    radius=radius_4,
    geometry=cull_12,
    I_2=Slider(0, range=0..100),
    I=Slider(2, range=0..10),
    value=division,
    L=concat_5)
maxfsr_2 = RemoteReceiver(maxfsr)
cluster_5 = Cluster_4(points=densitycorepts_3, radius=radius_5, geometry=geometry_9, value=maxfsr_2, L=concat_6)

panel_11 = Panel("""d2cbd,
AREA,
d2_cafe_2,
Population,2016_r1000_sum_flat,
n_dwellings_r1000_sum_flat,
SFD_r1000_sum_flat""")  # disabled
panel_12 = Panel("-123.11934")  # disabled
panel_13 = Panel("49.24966")  # disabled
pt_4 = ConstructPoint(XCoordinate=0, YCoordinate=0, ZCoordinate=0)  # disabled
shrimp_location_3 = ShrimpGISLocation(latitude=panel_13, longitude=panel_12, anchor_point=pt_4)  # -> location; inputs anchor_point: Point3d; disabled; plug-in component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
toggle_2 = BooleanToggle(True)  # disabled
path_4 = FilePath("G:\My Drive\Python\morphology\PhD\data\geojson\parcels4326_MetroVanRentPrice.geojson")  # disabled
shrimp_read_geojson_3 = ShrimpGISReadGeojson(geojson_file=path_4, location=shrimp_location_3, run_it=toggle_2)  # -> read_me, field, type, flatten(geometry); inputs run_it: Boolean; disabled; plug-in component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
panel_14 = Panel(shrimp_read_geojson_3.field)  # disabled
cluster_6 = Cluster(field=shrimp_read_geojson_3.field, name=panel_11)  # disabled
number_slider_4 = Slider(2, range=0..10)  # disabled
number_slider_5 = Slider(0.2, range=0..1)  # disabled
panel_15 = Panel("price_bed")  # disabled
cluster_7 = Cluster(field=shrimp_read_geojson_3.field, name=panel_15)  # disabled
randomsplit = RandomSplitList(MasterList=cluster_6, Seed=number_slider_4, Split=number_slider_5)  # -> ListA, ListB; disabled
number_slider_6 = Slider(8, range=0..10)  # disabled
randomsplit_2 = RandomSplitList(MasterList=cluster_7, Seed=number_slider_4, Split=number_slider_5)  # -> ListA, ListB; disabled
flip = FlipMatrix(Data=randomsplit.ListA)  # -> simplify(Data); disabled
flip_2 = FlipMatrix(Data=randomsplit.ListB)  # -> simplify(Data); disabled
number_slider_7 = Slider(25, range=0..50)  # disabled
galapagos = Galapagos(fitness=data_2, gene=[number_slider_6, number_slider_7])
data = Data(randomsplit_2.ListB)  # disabled
nonlinereg = NonlinearRegression(
    TestData=flip_2,
    TrainingInputs=flip,
    TrainingOutput=randomsplit_2.ListA,
    Sigma=number_slider_7,
    Complexity=100,
    RandomSeed=number_slider_6)  # -> Result, Score, Error; disabled
subtraction = Subtraction(A=nonlinereg.Result, B=data)  # disabled
expression_5 = Expression(P=nonlinereg.Result, O=data, Expression="(P - O)²")  # disabled
abs = Absolute(Value=subtraction)  # disabled
avr = Average(Input=abs)  # disabled
ma = MassAddition(Input=expression_5)  # -> Result, PartialResults; disabled
lng = ListLength(List=expression_5)  # disabled
expression_6 = Expression(R=ma.Result, C=lng, Expression="sqrt(R)/C")  # disabled
data_2 = Data(expression_6)  # disabled
panel_16 = Panel(data_2)  # disabled

# ==== cluster Cluster
field = ClusterInput()
shrimp_dec_field = ShrimpGISDecomposeField(field=field)  # -> read_me, name, values; inputs field: list; plug-in component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
name = ClusterInput()
index = ItemIndex(List=shrimp_dec_field.name, Item=shrimp_dec_field.name)
keysearch = KeyValueSearch(Keys=shrimp_dec_field.name, Values=index, Search=name)
branch = TreeBranch(Tree=shrimp_dec_field.values, Path=keysearch, MaintainPaths=True)
data = ClusterOutput(branch)

# ==== cluster Cluster_2
maxfsr = ClusterInput()
maxheight = ClusterInput()
parcels = ClusterInput()
dom = ConstructDomain(DomainStart="6", DomainEnd=maxheight)  # -> graft(Domain)
bnd = Bounds(Numbers=maxfsr)
landvalue = ClusterInput()
hardcosts = ClusterInput()
remap = RemapNumbers(Value=maxfsr, Source=bnd, Target=dom)  # -> simplify(Mapped), Clipped
sellprice = ClusterInput()
landvalue_2 = Data(landvalue)
land_residual_value = CSharpScript(
    Parcels=parcels,
    MaxFSR=maxfsr,
    MaxCoverage=0.6,
    MaxHeight=simplify(remap.Mapped),
    HardCosts=simplify(graft(hardcosts)),
    SoftCosts=0.15,
    NetGrossRatio=0.9,
    Commission=0.03,
    FinancingRate=0.05,
    ProfitTarget=0.15,
    SellPrice=simplify(sellprice),
    Contingency=0.1,
    GST=0.05)  # -> out, simplify(PFSR), simplify(BA), simplify(LRV); inputs Parcels: Surface, MaxFSR: Double, MaxCoverage: Double, MaxHeight: Double, HardCosts: Double, SoftCosts: Double, NetGrossRatio: Double, Commission: Double, FinancingRate: Double, ProfitTarget: Double, SellPrice: Double, Contingency: Double, GST: Double
# ---------- land_residual_value: C# ----------
    // Algorithms
    double Area = AreaMassProperties.Compute(Parcels).Area;
    double PracticalFSR = (MaxCoverage * Area * (MaxHeight / 3))/Area;
    double BuildableArea = Math.Min(MaxFSR, PracticalFSR) * Area;
    double TotalHardCosts = BuildableArea * HardCosts; // Add demolition costs
    double TotalSoftCosts = TotalHardCosts * SoftCosts;
    double TotalConstructionCosts = TotalHardCosts + TotalSoftCosts;
    double MarketableArea = BuildableArea * NetGrossRatio;
    double GrossRevenue = MarketableArea * SellPrice;
    double Subtotal = TotalConstructionCosts * (1 + Contingency);
    double FinancingCosts = Subtotal * FinancingRate;
    double ProfitCosts = GrossRevenue * ProfitTarget;
    double TotalCosts = Subtotal + FinancingCosts + ProfitCosts;
    double TotalPlusTax = TotalCosts * (1 + GST);
    double LandResidual = GrossRevenue - TotalPlusTax;

    // Outputs
    PFSR = PracticalFSR;
    BA = BuildableArea;
    LRV = LandResidual;
# ---------- end land_residual_value ----------
graft = GraftTree(Tree=maxfsr, IncludeEmptyLists=True, IncludeNullItems=True)
graft_2 = GraftTree(Tree=landvalue_2, IncludeEmptyLists=True, IncludeNullItems=True)
flip = FlipMatrix(Data=land_residual_value.BA)
flip_2 = FlipMatrix(Data=land_residual_value.PFSR)

# ---- group: Find largest residual
path_mapper = PathMapper(land_residual_value.LRV, source="{a}(i)", target="{i}")
index = ItemIndex(List=path_mapper, Item=path_mapper)
sort = SortList(Keys=path_mapper, ValuesA=index, ValuesB=flip_2, ValuesC=flip)  # -> reverse(Keys), reverse(ValuesA), reverse(ValuesB), reverse(ValuesC), reverse(ValuesD)
item = ListItem(List=sort.ValuesA, Index=0, Wrap=True)  # -> flatten(Item)
item_2 = ListItem(List=sort.Keys, Index=0, Wrap=True)  # -> flatten(Item)

# ----
panel = Panel(land_residual_value.out)
maxresidual = Data(item_2)
type = Data(item)
item_3 = ListItem(List=sort.ValuesB, Index=0, Wrap=True)  # -> flatten(Item)
item_4 = ListItem(List=sort.Keys, Index=0, Wrap=True)  # -> flatten(Item)
item_5 = ListItem(List=sort.ValuesC, Index=0, Wrap=True)  # -> flatten(Item)
larger = LargerThan(FirstNumber=item_2, SecondNumber=landvalue_2)  # -> LargerThan, OrEqualTo
maxresidual_2 = ClusterOutput(maxresidual)
type_2 = ClusterOutput(type)
ba = ClusterOutput(item_5)
pfsr = ClusterOutput(item_3)
lrv = ClusterOutput(item_4)
feasible = ClusterOutput(larger.LargerThan)
panel_2 = Panel("""Land Value
Max FSR
Practical FSR
Buildable Area
Residual Land Value
Feasible
Type""")
merge = Merge(
    Data1=simplify(graft_2),
    Data2=simplify(graft),
    Data3=simplify(graft(item_3)),
    Data4=simplify(graft(item_5)),
    Data5=simplify(graft(item_4)),
    Data6=simplify(graft(larger.LargerThan)),
    Data7=simplify(graft(type)))
keys = ClusterOutput(panel_2)
values = ClusterOutput(merge)

# ==== cluster Cluster_3
surfaces = ClusterInput()
surfaces_2 = Data(surfaces)
points = ClusterInput()
radius = ClusterInput()
points_2 = Data(points)
radius_2 = Data(radius)
c_script = CSharpScript(S=surfaces_2)  # -> out, A; inputs S: Surface
# ---------- c_script: C# ----------
A = S.GetBoundingBox(false).Center;
# ---------- end c_script ----------
circle = CircleCNR(Center=points_2, Normal=Vector(0, 0, 1), Radius=radius_2)
domain = ClusterInput()
parptincrvs = ParPointInCurves(Points=c_script.A, Curve=circle, Plane=PlaneXY(0, 0, 0), Strict=False)  # -> Included, Index
domain_2 = Data(domain)
rtree = CreateRTree(InputGeometry=c_script.A)
rtree_range = RTreePointsInRange(SearchPoints=points_2, SearchDistance=radius_2, RTree=rtree)  # -> PointsWithinRange, IndicesWithinRange
cull = CullPattern(List=c_script.A, CullPattern=parptincrvs.Included)
dedomain = DeconstructDomain(Domain=domain_2)  # -> Start, End
dom = ConstructDomain(DomainStart=0, DomainEnd=radius_2)
lng = ListLength(List=c_script.A)
c_script_2 = CSharpScript(L=c_script.A)  # -> out, i; inputs L: list
# ---------- c_script_2: C# ----------
    List<int> outList = new List<int>();
    for (int j = 0; j < L.Count; j++)
    {
      outList.Add(j);
    }
    i = outList;
# ---------- end c_script_2 ----------
dist = Distance(PointA=points_2, PointB=graft(cull))
repeat = RepeatData(Data=dedomain.Start, Length=lng)
item = ListItem(List=c_script.A, Index=rtree_range.IndicesWithinRange, Wrap=True)  # disabled
sort = SortList(Keys=dist)  # -> Keys, ValuesA
dom_2 = ConstructDomain(DomainStart=dedomain.End, DomainEnd=dedomain.Start)
cull_2 = CullPattern(List=c_script_2.i, CullPattern=parptincrvs.Included)
item_2 = ListItem(List=c_script_2.i, Index=rtree_range.IndicesWithinRange, Wrap=True)  # -> flatten(Item); disabled
item_3 = ListItem(List=sort.Keys, Index=0, Wrap=True)  # -> flatten(Item)
panel = Panel(item_3)
remap = RemapNumbers(Value=item_3, Source=dom, Target=dom_2)  # -> flatten(Mapped), Clipped
c_script_3 = CSharpScript(i=cull_2, D=remap.Mapped)  # -> out, outi, outD; inputs i: list of Int32, D: list of Double
# ---------- c_script_3: C# ----------
    DataTree<int> indicesTree = new DataTree<int>();
    DataTree <double> distancesTree = new DataTree<double>();
    DataTree <double> orderedDistancesTree = new DataTree<double>();

    for (int j = 0; j < i.Count; j++) {
      GH_Path path = new GH_Path(i[j]);
      indicesTree.Add(i[j], path);
      distancesTree.Add(D[j], path);
    }

    Print("" + distancesTree.BranchCount);
    for (int k = 0; k < distancesTree.BranchCount; k++) {
      GH_Path path = new GH_Path(k);
      List<double> values = new List<double>(distancesTree.Branches[k]);
      values.Sort();
      for (int v = 0; v < values.Count; v++) {
        orderedDistancesTree.Add(values[v], path);
      }
    }

    outi = indicesTree;
    outD = orderedDistancesTree;
# ---------- end c_script_3 ----------
item_4 = ListItem(List=c_script_3.outi, Index=0, Wrap=True)  # -> flatten(Item)
avr = Average(Input=c_script_3.outD)  # -> flatten(ArithmeticMean)
item_5 = ListItem(List=reverse(c_script_3.outD), Index=0, Wrap=True)  # -> flatten(Item)
item_6 = ListItem(List=c_script_3.outD, Index=0, Wrap=True)  # -> flatten(Item)
panel_2 = Panel(c_script_3.outD)
replace = ReplaceItems(List=repeat, Item=item_5, Indices=item_4, Wrap=False)
bnd = Bounds(Numbers=replace)
dedomain_2 = DeconstructDomain(Domain=bnd)  # -> MinFSR, MaxFSR
fsr = ClusterOutput(replace)
minfsr = ClusterOutput(dedomain_2.MinFSR)
maxfsr = ClusterOutput(dedomain_2.MaxFSR)

# ==== cluster Cluster_4
value = ClusterInput()
I = ClusterInput()
I_2 = ClusterInput()
number_slider = Slider(30, range=0..100)
bnd = Bounds(Numbers=value)
null = NullItem(Item=I_2)  # -> NullFlags, InvalidFlags, Description
null_2 = NullItem(Item=I)  # -> NullFlags, InvalidFlags, Description
points = ClusterInput()
radius = ClusterInput()
geometry = ClusterInput()
dedomain = DeconstructDomain(Domain=bnd)  # -> Start, End
series = Series(Start=0, Step=1, Count=expr("x*2", number_slider))
or = GateOr(A=null.NullFlags, B=null_2.NullFlags)
circle = CircleCNR(Center=points, Normal=Vector(0, 0, 1), Radius=radius)
bnd_2 = Bounds(Numbers=series)
filter = StreamFilter(Gate=or, Stream0=I_2, Stream1=dedomain.Start)
filter_2 = StreamFilter(Gate=or, Stream0=I, Stream1=dedomain.End)
runion = RegionUnion(Curves=circle)
dedomain_2 = DeconstructDomain(Domain=bnd_2)  # -> Start, End
div = DivideDomain(Domain=bnd_2, Count=10)
l1 = RemoteSender(filter_2)
gradient = Gradient(
    LowerLimit=dedomain_2.Start,
    UpperLimit=dedomain_2.End,
    Parameter=series,
    stops=[0: RGB(143, 114, 229), 0.167: RGB(137, 181, 229), 0.341: RGB(161, 230, 224), 0.5: RGBA(190, 190, 190, 196), 0.667: RGB(176, 229, 160), 0.833: RGB(229, 229, 137), 1: RGB(229, 143, 114)])
l0 = RemoteSender(filter)
panel = Panel(gradient)
gradient_2 = Gradient(
    LowerLimit=filter,
    UpperLimit=filter_2,
    Parameter=value,
    stops=[0: RGB(143, 114, 229), 0.167: RGB(137, 181, 229), 0.341: RGB(161, 230, 224), 0.5: RGBA(190, 190, 190, 196), 0.667: RGB(176, 229, 160), 0.833: RGB(229, 229, 137), 1: RGB(229, 143, 114)])
dedomain_3 = DeconstructDomain(Domain=div)  # -> Start, End
geometry_2 = Data(geometry)
number_slider_2 = Slider(4000, range=0..10000)
division = Division(A=number_slider_2, B=number_slider)
number_slider_3 = Slider(642, range=0..1000)
previewlw = CustomPreviewLineweights(Geometry=geometry_2, Shader=gradient_2, Absolute=False)  # disabled
border = SurfaceBorder(Surface=geometry_2)  # -> simplify(OuterBorder), InnterBorder
fill = CreateGdiFill(Colour=gradient_2)  # -> simplify(graft(Fill))
edge = CreateGdiEdge(Width=10, Colour=RGB(0, 0, 0), EndCap=0, DashCap=0)
brec = BoundingRectangle(Geometry=geometry_2, Plane=PlaneXY(0, 0, 0), Axis=0, Slide=0, Union=True)  # -> Bounding, DimensionX, DimensionY
panel_2 = Panel(gradient_2)
shape = CreateGdiShape(Geometry=border.OuterBorder, Fill=fill)  # -> flatten(Shape)
shape_2 = CreateGdiShape(Geometry=runion, Edge=edge)
number_slider_4 = Slider(400, range=0..1000)
explode = Explode(Curve=brec.Bounding, Recursive=True)  # -> Segments, Vertices
Y = UnitY(Factor=number_slider_3)
X = UnitX(Factor=number_slider_3)
item = ListItem(List=explode.Vertices, Index=0, Wrap=True)
addition = Addition(A=X, B=Y)
Y_2 = UnitY(Factor=number_slider_2)
l1_2 = RemoteReceiver(l1)
l0_2 = RemoteReceiver(l0)
move = Move(Geometry=item, Motion=addition)  # -> Geometry, Transform
X_2 = UnitX(Factor=number_slider_4)
move_2 = Move(Geometry=move.Geometry, Motion=expr("x/2", Y_2))  # -> Geometry, Transform
move_3 = Move(Geometry=move.Geometry, Motion=Y_2)  # -> Geometry, Transform
subtraction = Subtraction(A=l1_2, B=l0_2)
data = Data(division)
move_4 = Move(Geometry=move.Geometry, Motion=expr("x/2", X_2))  # -> Geometry, Transform
num = Number(expr("x/2", subtraction))
Y_3 = UnitY(Factor=data)
entwine = Entwine(Branch00=move.Geometry, Branch01=move_2.Geometry, Branch02=move_3.Geometry, FlattenInputs=True)
rectangle = Rectangle(Plane=move.Geometry, XSize=number_slider_4, YSize=data, Radius=0)  # -> Rectangle, Length
num_2 = Number(expr("x/8", number_slider_4))
X_3 = UnitX(Factor=number_slider_4)
data_2 = Data(panel)
entwine_2 = Entwine(Branch00=l0_2, Branch01=num, Branch02=l1_2, FlattenInputs=True)
arrlinear = LinearArray(Geometry=move_4.Geometry, Direction=Y_3, Count=number_slider)  # -> simplify(graft(Geometry)), Transform
merge = Merge(Data1=shape_2, Data2=shape)  # -> flatten(Result)
arrlinear_2 = LinearArray(Geometry=rectangle.Rectangle, Direction=Y_3, Count=number_slider)  # -> graft(Geometry), Transform
roundd = RoundToDecimalPlace(NumberX=entwine_2, DecimalPlace=2, RoundType=0)  # -> Rounded, Difference
move_5 = Move(Geometry=entwine, Motion=expr("x * 1.5", X_3))  # -> Geometry, Transform
partition = PartitionList(List=data_2, Size=2)  # -> simplify(Chunks)
font = CreateGdiFont(Typeface="Microsoft Sans Serif", Size=num_2, Bold=False, Italic=False)
move_6 = Move(Geometry=arrlinear.Geometry, Motion=Y_3)  # -> Geometry, Transform
item_2 = ListItem(List=partition, Index=0, Wrap=True)
item_3 = ListItem(List=partition, Index=1, Wrap=True)
boundary = BoundarySurfaces(Edges=arrlinear_2.Geometry)
ln = Line(StartPoint=arrlinear.Geometry, EndPoint=move_6.Geometry)
ghatch = GradientHatch(Boundaries=boundary, Axis=ln, Colour1=item_2, Colour2=item_3)
gradient_3 = CreateGdiGradient(Colour1=item_2, Colour2=item_3, Point1=arrlinear.Geometry, Point2=move_6.Geometry)
text = CreateText(Text=roundd.Rounded, Font=font, Location=move_5.Geometry, Colour=RGB(0, 0, 0))  # -> flatten(Text)
shape_3 = CreateGdiShape(Geometry=arrlinear_2.Geometry, Fill=gradient_3)  # -> flatten(Shape)
merge_2 = Merge(Data1=shape_3, Data2=text)
L = ClusterInput()
merge_3 = Merge(Data1=merge, Data2=merge_2)
draw = DrawImage(
    Shapes=merge_3,
    Size=brec.Bounding,
    Factor=Slider(0.2, range=0..1),
    Background=RGBA(255, 255, 255, 0),
    AntiAlias=True,
    FileLocation=L)
